# Grasshopper definition Infrared.gh (Grasshopper 1.0.7)
# plug-ins: Geospatial, Pufferfish, MeshEdit Components, Authenticate, CreateProject, WindSpeedAnalysis, LoadProject, SyncSnapshot, RunAnalyses, ReadAnalyses, Human, Kangaroo2 Components

# ----
# Step 01: Load Credentials
panel = Panel("iaac-sophie")
ir_auth = InFraReDAuthenticate(Username=panel, Password="S0phie&Infrar3d")
panel_2 = Panel(ir_auth)

# ----
# Step 05: Automatically move slider with the name "animate"
button = Button()
c_script = CSharpScript(reset=button, run=Button(), SliderNames="animate")  # -> out, A; inputs reset: Boolean, run: Boolean, SliderNames: list of String, Runs: Int32
# ---------- c_script: C# usings ----------
using Grasshopper.Kernel.Special;
using Grasshopper.Kernel.Parameters;
# ---------- c_script: C# ----------
    if (!run)
    {
      gH_Document = Component.OnPingDocument();
      _SliderNames = SliderNames;
      _sliders = FindSlidersByName();

    }

    if (run)
      GrasshopperDocument.ScheduleSolution(60000, ScheduleCallback);

    if (reset) resetSliders(_sliders);
# ---------- c_script: C# additional code ----------
  private GH_NumberSlider[] _sliders;
  GH_Document gH_Document;
  List<string> _SliderNames;

  private void ScheduleCallback(GH_Document document)
  {
    foreach (var slider in _sliders){
      decimal max = slider.Slider.Maximum;
      decimal current = slider.Slider.Value;
      decimal places = slider.Slider.DecimalPlaces;
      decimal iterator = (decimal) (1 / (Math.Pow(10, (int) places)));

      for (decimal k = current; k <= max; k += iterator)
        slider.TrySetSliderValue((decimal) k);
    }

  }

  private void resetSliders(GH_NumberSlider[] _sliders){

    foreach (var slider in _sliders){
      slider.TrySetSliderValue((decimal) 0);

    }
  }


  private GH_NumberSlider[] FindSlidersByName()
  {

    var sliders = new List<GH_NumberSlider>();

    foreach(var NickName in _SliderNames)
      foreach (var obj in gH_Document.Objects)
      {
        if(obj.NickName == NickName){
          var slider = obj as GH_NumberSlider;
          if (slider != null)
            sliders.Add(slider);
        }

      }
    return sliders.ToArray();
  }


  private GH_NumberSlider[] FindSliders()
  {

    var sliders = new List<GH_NumberSlider>();

    foreach (var obj in gH_Document.Objects)
    {
      if(_SliderNames.Contains(obj.NickName)){
        var slider = obj as GH_NumberSlider;
        if (slider != null)
          sliders.Add(slider);
      }

    }
    return sliders.ToArray();
  }
# ---------- end c_script ----------
panel_3 = Panel(c_script.A)

# ----
# Step 02: Create Project
# Dont enable 'create project' component until everything is pluged in and then disable as soon as the component has run.
panel_4 = Panel("Vienna0")
ir_wind_speed = InFraReDWindSpeedAnalysis(WindSpeed="1", WindDirection="0")
rectangle = Rectangle(Plane=PlaneXY(0, 0, 0), XSize="500", YSize="500", Radius=0)  # -> Rectangle, Length
ir_create_proj = InFraReDCreateProject(ProjectName=panel_4, SiteBoundary=rectangle.Rectangle, AnalysesSettings=ir_wind_speed)  # -> SiteBoundary, ProjectMetadata, Snapshots; disabled

jagged = SettingsSpeed()
ir_load_proj = InFraReDLoadProject(ProjectName=panel_4)  # -> SiteBoundary, ProjectMetadata, Snapshots

# ---- group: Image sampler / rapid point in surface generation
geometry_crv = Geometry(ir_load_proj.SiteBoundary)
sqm_per_pts = Slider(5, range=0..10)
grid_adj_for_direction_of_block = GridAdjForDirectionOfBlock(geometry=geometry_crv, resolution=sqm_per_pts)  # -> flatten(points)

# ----
samplepoints = Data(grid_adj_for_direction_of_block)

# ---- group: writer / compile dataset
panel_5 = Panel("C:\Users\Sophie\Desktop\infrared0to99.csv")

# ---- group: Create bounding boxes
sqgrid = Square(Plane=PlaneXY(0, 0, 0), Size="500", ExtentX="31", ExtentY="31")  # -> flatten(Cells), flatten(Points)
animate = Slider(0, range=0..900)
panel_6 = Panel("-250 to 250")
panel_7 = Panel("-750 to 750")

# ----
duppt = RemoveDuplicatePts(Points=sqgrid.Points, Tolerance=0.01)
concat = Concatenate(FragmentA="snap", FragmentB=animate)

# ---- group: buidlings
readjson = ReadGeoJSON(File="C:\Users\Sophie\Downloads\buildings_proj.geojson")  # -> Type, flatten(Geometry), Keys, Values
item = ListItem(List=readjson.Values, Index=0, Wrap=True)  # -> flatten(Item)
int = Integer("2")

# ---- group: Streets
# Step 03: Specify path to street and building geojson files (takes a couple mins to load)
panel_8 = Panel("C:\Users\Sophie\Downloads\streets_proj.geojson")
readjson_2 = ReadGeoJSON(File=panel_8)  # -> Type, flatten(Geometry), Keys, Values
bbox = BoundingBox(Content=flatten(readjson_2.Geometry), Plane=PlaneXY(0, 0, 0), UnionBox=True)  # -> Box, Box_2
box_corners = BoxCorners(Box=bbox.Box)  # -> CornerA, CornerB, CornerC, CornerD, CornerE, CornerF, CornerG, CornerH
move2pt = MoveToPoint(Geometry=readjson_2.Geometry, PointA=box_corners.CornerA, PointB="{0,0,0}")  # -> Moved, Vector, Transform
midpt = CurveMiddle(Curve=move2pt.Moved)
int_2 = Integer("2")

# ---- group: Create bounding boxes (continued)
frompoints = MeshFromPoints(Points=duppt, UDirection="32", VDirection="32")

# ----
nv = NakedVertices(Mesh=frompoints)  # -> ClothedIndex, NakedIndex, ClothedPts, NakedPts

# ---- group: Create bounding boxes (continued)
geo = Geometry(nv.ClothedPts)

# ---- group: Create bounding boxes / analysis bounding box
rectangle_2 = Rectangle(Plane=geo, XSize=panel_6, YSize=panel_6, Radius=0)  # -> Rectangle, Length

# ---- group: Create bounding boxes / context bounding box
rectangle_3 = Rectangle(Plane=geo, XSize=panel_7, YSize=panel_7, Radius=0)  # -> Rectangle, Length

# ---- group: Create bounding boxes (continued)
preview = CustomPreview(Geometry=rectangle_2.Rectangle, Material=ColourSwatch(SwatchColor=RGB(10, 81, 168)))
item_2 = ListItem(List=rectangle_3.Rectangle, Index=animate, Wrap=True)
item_3 = ListItem(List=rectangle_2.Rectangle, Index=animate, Wrap=True)
explode = Explode(Curve=item_3, Recursive=True)  # -> Segments, Vertices
item_4 = ListItem(List=explode.Vertices, Index=0, Wrap=True)

# ---- group: buidlings (continued)
move2pt_2 = MoveToPoint(Geometry=readjson.Geometry, PointA=box_corners.CornerA, PointB="{0,0,0}")  # -> Moved, Vector, Transform
area = Area(Geometry=move2pt_2.Moved)  # -> Area, Centroid
incurve = PointInCurve(Point=area.Centroid, Curve=item_2)  # -> Relationship, Point
int_3 = Integer(incurve.Relationship)
mindex = MemberIndex(Set=int_3, Member=int)  # -> Index, Count
item_5 = ListItem(List=item, Index=mindex.Index, Wrap=True)
item_6 = ListItem(List=move2pt_2.Moved, Index=mindex.Index, Wrap=True)
Z = UnitZ(Factor=item_5)
extr = Extrude(Base=item_6, Direction=Z)
cap = CapHoles(Brep=extr)

# ---- group: Streets (continued)
incurve_2 = PointInCurve(Point=midpt, Curve=item_3)  # -> Relationship, Point
int_4 = Integer(incurve_2.Relationship)
mindex_2 = MemberIndex(Set=int_4, Member=int_2)  # -> Index, Count
item_7 = ListItem(List=move2pt.Moved, Index=mindex_2.Index, Wrap=True)

# ---- group: street id
item_8 = ListItem(List=readjson_2.Values, Index="3", Wrap=True)
item_9 = ListItem(List=readjson_2.Values, Index="2", Wrap=True)
item_10 = ListItem(List=readjson_2.Values, Index="1", Wrap=True)
item_11 = ListItem(List=readjson_2.Values, Index="0", Wrap=True)
join = TextJoin(Text=[item_11, item_9, item_10, item_8], Join=",")  # -> flatten(Result)
item_12 = ListItem(List=join, Index=mindex_2.Index, Wrap=True)

# ----
move2pt_3 = MoveToPoint(Geometry=item_7, PointA=item_4, PointB="{0,0,0}")  # -> Moved, Vector, Transform
move2pt_4 = MoveToPoint(Geometry=cap, PointA=item_4, PointB="{0,0,0}")  # -> Moved, Vector, Transform
mesh = MeshBrep(Brep=move2pt_4.Moved, Settings=jagged)
python = GhPythonScript(B=mesh)  # -> out; inputs B: list of Mesh
# ---------- python: Python ----------
import rhinoscriptsyntax as rs
import Grasshopper, GhPython
import System
import Rhino
import ghpythonlib.components as ghcomp
import ghpythonlib.parallel as pr

def str_rounder(x, dp):
    assert dp > 0, 'dp should be bigger than 0'
    str_rep = str(round(x, dp)).split('.')
    if len(str_rep) == 1:
        return str_rep[0] + '.' + '0'*dp
    else:
        max_dec = len(str_rep[1][:dp])
        return str_rep[0] + '.' + str_rep[1][:dp] + '0'*(dp-max_dec)

def mesh2json(master):
                """Definition to process meshes."""
        
                # unpack master list
                mesh = rs.coercemesh(master['mesh'])
                buildingUse = master['buildingUse']
                refX = master['projOrigin'][0]
                refY =  master['projOrigin'][1]
                
                # get footprint
                vec = rs.CreateVector([0, 0, 1])
                plane = rs.CreatePlane([0, 0, 0])
                curves = []
                crv = ghcomp.MeshShadow(mesh, vec, plane)
                if crv == None:
                    # smooth mesh in cased mesh shadow failed
                    smooth_m = ghcomp.SmoothMesh(mesh, 0.5, True, 1)
                    crv = ghcomp.MeshShadow(smooth_m, vec, plane)
                
                # simplify curves
                curves = ghcomp.SimplifyCurve(crv).curve
                
                # get height
                verts = ghcomp.DeconstructMesh(mesh).vertices
                z = []
                for i in verts:
                    z.append(i.Z)
                z.sort()
                min_, max_ = z[0], z[-1]
                height = round(max_ - min_, 2)
                
                # create JSON structure
                # Ensure list as data structure
                if isinstance(curves, list):
                    pass
                else:
                    curves = [curves]
        
                poly_list = []
                for i in range(1):  # Note, only takes the outer crv
                    cur_crv = curves[i]
                    coor_list = rs.CurvePoints(cur_crv)
                    cur_polygon = []
                    for pt in coor_list:
                        cur_polygon.append([
                            str_rounder(pt.X - refX, 2),
                            str_rounder(pt.Y - refY, 2)
                        ])
                    if cur_polygon[0] != cur_polygon[-1]:
                        cur_polygon.append(cur_polygon[0])
                    poly_list.append([cur_polygon])
                    
                building = {
                    'buildingGeometry': {'type': 'Polygon', 'coordinates': poly_list},
                    'buildingUse': buildingUse,
                    'buildingHeight': height,
                }
                return ([curves, height], building)
                
def RunScript(B):
        result = None

        # Input parameter checking and defaults
        if B != []:
            B = B
        else:
            component.AddRuntimeMessage(
                self,
                Grasshopper.Kernel.GH_RuntimeMessageLevel.Warning,
                'Input parameter B failed to collect data.'
            )
            return

        # set defaults for attributes
        len_b = len(B)
        
        # structure data for threading 
        masterList = []
        for i in range(len_b):
            temp = {
                'mesh': B[i],
                'buildingUse': 0,
                'projOrigin': (0, 0, 0)
            }
            masterList.append(temp)
        
        # run main function
        data = pr.run(mesh2json, masterList)
        result = {'json': [],'geometry': []}
        for obj in data:
            result['geometry'].append(obj[0])
            result['json'].append(obj[1])
        
        return [result]
        
out = RunScript(B)
# ---------- end python ----------
ir_sync = InFraReDSyncSnapshot(Name=flatten(concat), Description=flatten(concat), Buildings=flatten(python), SiteBoundary=flatten(item_3))  # -> SnapshotMetadata, BuildingsInFraReDSchema, StreetsInFraReDSchema, POIsInFraReDSchema

# ---- group: prevent analysis from running until snapshot has been created
null = NullItem(Item=ir_sync.SnapshotMetadata)  # -> NullFlags, InvalidFlags, Description
expression = Expression(x=null.NullFlags, y=concat, z="do nothing", Expression="if(x=False, y, z)")

# ----
ir_run = InFraReDRunAnalyses(Name=expression)
bang = ExplodeTree(Data=ir_run)  # -> Branch0, Branch1, Branch2
ir_read = InFraReDReadAnalyses(AnalysesResults=bang.Branch0)  # -> RawData, KPINames, KPIValues
python_2 = GhPythonScript(bm=ir_read.RawData)  # -> flipped
# ---------- python_2: Python ----------
__author__ = "DueringS"
__version__ = "2021.06.29"

import rhinoscriptsyntax as rs
import System


bm.RotateFlip(System.Drawing.RotateFlipType.RotateNoneFlipY)
flipped = bm
# ---------- end python_2 ----------

# ---- group: Image sampler
bitmap = Data(python_2)
siteboundary = Data(ir_load_proj.SiteBoundary)
cluster = Cluster_2(bitmaps=bitmap, siteboundary=siteboundary, sample_points=grid_adj_for_direction_of_block)

# ----
argb = SplitARGB(Colour=cluster)  # -> Alpha, Red, Green, Blue

# ---- group: Filter invalid areas (under buildings)
val = Data(argb.Red)
geo_2 = Data(samplepoints)
equals = Equality(FirstNumber=argb.Alpha, SecondNumber=0)  # -> Equality, Inequality
cull = CullPattern(List=val, CullPattern=equals.Inequality)
cull_2 = CullPattern(List=geo_2, CullPattern=equals.Inequality)

# ---- group: remap to wind speeds
panel_9 = Panel("0 to 1")
remap = RemapNumbers(Value=cull, Source=Domain(0, 1), Target=panel_9)  # -> Mapped, Clipped

# ---- group: visualize performance of street segments
divdist = DivideDistance(Curve=move2pt_3.Moved, Distance="20")  # -> Points, Tangents, Parameters
cp = ClosestPoint(Point=divdist.Points, Cloud=cull_2)  # -> ClosestPoint, CPIndex, Distance
item_13 = ListItem(List=cull, Index=cp.CPIndex, Wrap=True)
avr = Average(Input=item_13)  # -> flatten(ArithmeticMean)
gradient = Gradient(
    LowerLimit="1",
    UpperLimit="0",
    Parameter=flatten(avr),
    stops=[0: RGB(234, 38, 0), 0.25: RGB(234, 126, 0), 0.5: RGB(254, 244, 84), 0.75: RGB(173, 203, 249), 1: RGB(75, 107, 169)])
previewlw = CustomPreviewLineweights(Geometry=move2pt_3.Moved, Shader=flatten(gradient), Thickness="10", Absolute=False)

# ---- group: prevent time from being printed until analysis has finished
null_2 = NullItem(Item=avr)  # -> NullFlags, InvalidFlags, Description
expression_2 = Expression(x=null_2.NullFlags, y="get time", z="do nothing", Expression="if(x=False, y, z)")  # -> flatten(R)

# ----
python_3 = GhPythonScript(x=expression_2)  # -> out, a
# ---------- python_3: Python ----------
__author__ = "Sophie"
__version__ = "2022.05.21"

import rhinoscriptsyntax as rs
from datetime import datetime

if x == 'get time':
    

    now = datetime.now()
    current_time = now.strftime("%H:%M:%S")
    a = current_time
# ---------- end python_3 ----------
weave = Weave(
    Pattern=[0, 1, 2, 3],
    Stream0=graft(item_12),
    Stream1=graft(animate),
    Stream2=graft(python_3.a),
    Stream3=graft(avr),
    NullGaps=False)

# ---- group: writer
# Step 04: Specify file path that data should be written to
panel_10 = Panel("""u
v
key
level3
iter
time
wdir1
wdir2
wdir3
wdir4
wdir5
wdir6
wdir7
wdir8""")
join_2 = TextJoin(Text=weave, Join=",")
join_3 = TextJoin(Text=panel_10, Join=",")
export_robotmotion_3_r3_multi = PythonScript(toggle=Toggle(False), path=panel_5, x=join_2, labs=join_3, y=Slider(2, range=0..10))
# ---------- export_robotmotion_3_r3_multi: Python ----------
#script by Gabriella Rossi / CITA
import os
from os import listdir
from os.path import isfile, join
from scriptcontext import sticky as st

if True:
    #Create file
    filename = str(path)
    fil = open(filename, 'a+')
    
    if y < 1 :

        #write header and first line
        fil.write(labs)
        fil.write('\n' + x)
    else:
        #just write line
        fil.write('\n' + x)

    fil.close()
# ---------- end export_robotmotion_3_r3_multi ----------

# ---- group: Visualize
dedomain = DeconstructDomain(Domain=panel_9)  # -> Start, End
gradient_2 = Gradient(
    LowerLimit=dedomain.End,
    UpperLimit=dedomain.Start,
    Parameter=remap.Mapped,
    stops=[0: RGB(234, 38, 0), 0.25: RGB(234, 126, 0), 0.5: RGB(254, 244, 84), 0.75: RGB(173, 203, 249), 1: RGB(75, 107, 169)])
cloud = CloudDisplay(Points=cull_2, Colours=gradient_2, Size="2", SpriteType=0)

# ----
panel_11 = Panel(join_2)

# ==== cluster GridAdjForDirectionOfBlock
geometry = ClusterInput()
reg_grid = BooleanToggle(True)
project = Project(Geometry=geometry, Plane=PlaneXY(0, 0, 0))  # -> Geometry, Transform
resolution = ClusterInput()
geometry_crv = Geometry(project.Geometry)
bounding_box = BoundingBox(Content=geometry_crv, Plane=PlaneXY(0, 0, 0), UnionBox=False)  # -> Box, Box_2
box_properties = BoxProperties(Box=bounding_box.Box)  # -> Center, Diagonal, Area, Volume, Degeneracy
orthogonal_vectors_datatree_edition = CSharpScript()  # -> A; inputs y: tree of Point3d
# ---------- orthogonal_vectors_datatree_edition: C# ----------
    DataTree<Vector3d> vList = new DataTree<Vector3d>();


    for (int k = 0; k < y.BranchCount; k++)
    {
      for (int i = 0; i < y.Branch(i).Count; i++)
      {

        int xx = 1;
        int yy = 1;

        // ensure x is always positive & that one of x or y is flipt
        if ( y.Branch(k)[i].Y < 0)
        {yy = -1;} else xx = -1;

        Vector3d newVC = new Vector3d(y.Branch(k)[i].Y * yy, y.Branch(k)[i].X * xx, 0);
        vList.Add(newVC, new GH_Path(k));


      }
    }

    A = vList;
# ---------- end orthogonal_vectors_datatree_edition ----------

# ---- group: get direction (ortho. Vector)
smplf_crv = Slider(20, range=0..100)
cluster = Cluster(curves=geometry_crv, tolerance=smplf_crv)  # -> A, ori_vector
ortho_vector = Data(cluster.A)

# ----
vector_xyz = VectorXYZ(XComponent=1, YComponent=0, ZComponent=0)  # -> OrthoV, Length
vector_xyz_2 = VectorXYZ(XComponent=0, YComponent=1, ZComponent=0)  # -> Vector, Length
geometry_2 = Geometry(graft(geometry_crv))
data = Data(box_properties.Diagonal)
stream_filter = StreamFilter(Gate=reg_grid, Stream0=vector_xyz_2.Vector, Stream1=cluster.ori_vector)
stream_filter_2 = StreamFilter(Gate=reg_grid, Stream0=vector_xyz.OrthoV, Stream1=ortho_vector)
point_on_curve = PointOnCurve(geometry_2, parameter=0.5)
multiplication = Multiplication(A=data, B=3)
division = Division(A=multiplication, B=2)
vector_display = VectorDisplay(Anchor=flatten(point_on_curve), Vector=stream_filter)
multiplication_2 = Multiplication(A=stream_filter, B=-1)
boolean_toggle = BooleanToggle(False)

# ---- group: higher resolution to narrow shapes
area = Area(Geometry=geometry_crv, UseTasks=False)  # -> Area, Centroid
length = Length(Curve=geometry_crv)
factor_threshold = Panel("10")
division_2 = Division(A=area.Area, B=length)
ghpython_script = GhPythonScript(x=division_2, y=factor_threshold, z=boolean_toggle)  # -> out, a; inputs x: list, y: Int32, z: list
# ---------- ghpython_script: Python ----------
__author__ = "DueringS"
__version__ = "2018.10.30"

import rhinoscriptsyntax as rs
zz = min(z)
adj = []


#for less compact shapes (eg. very narrow) the resolution is increasesd

for i in range(len(x)):
    if x[i] <= y:
        adj.append(zz)
    else:
        adj.append(z[i])
a = adj
# ---------- end ghpython_script ----------

# ----
line_sdl = LineSDL(Start=box_properties.Center, Direction=stream_filter, Length=multiplication)
amplitude = Amplitude(Vector=multiplication_2, Amplitude=division)
panel = Panel(amplitude)
ortho_vector_2 = Data(simplify(graft(stream_filter_2)))

# ---- group: Lines to shoot rays from
move = Move(Geometry=line_sdl, Motion=amplitude)  # -> Geometry, Transform

# ----
multiplication_3 = Multiplication(A=ortho_vector_2, B=-1)
amplitude_2 = Amplitude(Vector=multiplication_3, Amplitude=simplify(graft(box_properties.Diagonal)))  # -> flatten(Vector)

stream_filter_3 = StreamFilter(Gate=boolean_toggle, Stream0=resolution, Stream1=ghpython_script.a)
length_2 = Data(graft(data))
to_make_sure = Slider(3, range=0..10)
length_3 = Length(Curve=move.Geometry)
move_2 = Move(Geometry=move.Geometry, Motion=amplitude_2)  # -> flatten(Geometry), Transform
data_2 = Data(stream_filter_3)
division_3 = Division(A=length_3, B=data_2)
multiplication_4 = Multiplication(A=length_2, B=to_make_sure)
divide_curve = DivideCurve(Curve=simplify(graft(move_2.Geometry)), Count=simplify(graft(division_3)), Kinks=False, UseTasks=False)  # -> simplify(Points), Tangents, Parameters
multiplication_5 = Multiplication(A=multiplication_4, B=-1)
line_sdl_2 = LineSDL(Start=divide_curve.Points, Direction=ortho_vector_2, Length=multiplication_4)
sort_list = SortList(Keys=boolean_toggle)  # -> Keys, ValuesValuesA
curve_line = CurveLine(Curve=simplify(geometry_2), Line=simplify(line_sdl_2))  # -> simplify(Points), Params, Count
list_length = ListLength(List=sort_list.Keys)
duplicate_data = DuplicateData(Data=resolution, Number=list_length, Order=True)
quick_graph = QuickGraph([sort_list.Keys, resolution, duplicate_data], SortOrder=0)

# ---- group: yay works
sort_points = SortPoints(Points=curve_line.Points)  # -> simplify(Points), Indices

# ---- group: Check datastructure
tree_statistics = TreeStatistics(Tree=sort_points.Points)  # -> Paths, Length, Count
deconstruct_path = DeconstructPath(Branch=tree_statistics.Paths)  # -> simplify(Indices)
list_length_2 = ListLength(List=deconstruct_path)  # -> flatten(Length)
list_item = ListItem(List=list_length_2, Index=0, Wrap=True)
larger_than = LargerThan(FirstNumber=list_item, SecondNumber=1)  # -> LargerThan, OrEqualTo

# ---- group: adjust depth
list_length_3 = ListLength(List=geometry_crv)
ghpython_script_2 = GhPythonScript(x=list_length_3)  # -> a
# ---------- ghpython_script_2: Python ----------
__author__ = "DueringS"
__version__ = "2020.11.27"

import rhinoscriptsyntax as rs

if x == 1:
    a = 0
else:
    a = 1
# ---------- end ghpython_script_2 ----------

# ----
path_mapper = PathMapper(sort_points.Points, source="{A;B}", target="{path_index}")
trim_tree = TrimTree(Tree=sort_points.Points, Depth=ghpython_script_2)
data_3 = Data(path_mapper)
stream_filter_4 = StreamFilter(Gate=larger_than.LargerThan, Stream0=path_mapper, Stream1=trim_tree)
dispatch = Dispatch(List=trim_tree, DispatchPattern=[True, False])  # -> ListA, ListB
line = Line(StartPoint=dispatch.ListA, EndPoint=dispatch.ListB)
length_4 = Length(Curve=line)
division_4 = Division(A=length_4, B=graft(data_2))  # -> simplify(Result)
divide_curve_2 = DivideCurve(Curve=line, Count=division_4, Kinks=False, UseTasks=False)  # -> simplify(Points), Tangents, Parameters
panel_2 = Panel(divide_curve_2.Points)
# hint: deactivate parallel computing .. for a huge speed up
points = ClusterOutput(divide_curve_2.Points)
reg_grid_2 = BooleanToggle(True)

# ==== cluster Cluster_2
bitmaps = ClusterInput()
siteboundary = ClusterInput()
sample_points = ClusterInput()
bitmaps_2 = Data(bitmaps)
siteboundary_2 = Geometry(siteboundary)
sample_points_2 = Data(simplify(sample_points))
ghpython_script = GhPythonScript(bm=bitmaps_2, scale=Slider(1.001, range=0..5))  # -> H, W
# ---------- ghpython_script: Python ----------
__author__ = "DueringS"
__version__ = "2021.06.28"

import rhinoscriptsyntax as rs
H = int(bm.Size.Height / scale)
W = int(bm.Size.Width / scale)
# ---------- end ghpython_script ----------
img_h = Data(flatten(ghpython_script.H))
img_w = Data(flatten(ghpython_script.W))
list_item = ListItem(List=img_w, Index=0, Wrap=True)
list_item_2 = ListItem(List=img_h, Index=0, Wrap=True)
panel = Panel(list_item)
box_corners = BoxCorners(Box=siteboundary_2)  # -> CornerA, CornerB, CornerC, CornerD, CornerE, CornerF, CornerG, CornerH
panel_2 = Panel(list_item_2)
distance = Distance(PointA=box_corners.CornerB, PointB=box_corners.CornerA)
ref = Data(box_corners.CornerD)
distance_2 = Distance(PointA=box_corners.CornerA, PointB=box_corners.CornerD)
deconstruct = Deconstruct(Point=ref)  # -> XComponent, YComponent, ZComponent
deconstruct_2 = Deconstruct(Point=sample_points_2)  # -> XComponent, YComponent, ZComponent
division = Division(A=panel, B=distance)
subtraction = Subtraction(A=deconstruct_2.YComponent, B=deconstruct.YComponent)
subtraction_2 = Subtraction(A=deconstruct_2.XComponent, B=deconstruct.XComponent)
division_2 = Division(A=panel_2, B=distance_2)
multiplication = Multiplication(A=subtraction, B=division_2)
multiplication_2 = Multiplication(A=subtraction_2, B=division)
construct_point = ConstructPoint(XCoordinate=multiplication_2, YCoordinate=expr("x*-1", multiplication), ZCoordinate=0)  # -> simplify(Point)
pixelid = Data(construct_point)
ghpython_script_2 = GhPythonScript(bit=flatten(bitmaps_2), pixID=pixelid)  # -> colTr; inputs bit: list, pixID: list of Point3d
# ---------- ghpython_script_2: Python ----------
__author__ = "sers"
__version__ = "2019.07.18"

import rhinoscriptsyntax as rs
import System.Drawing as sd
import System.Drawing.Bitmap as bt
import System.IO as sio
import base64

import Grasshopper
import Grasshopper.DataTree as tree
import Grasshopper.Kernel.Data.GH_Path as ghpath
import ghpythonlib.parallel as pr
#sd.RotateFlipType(4)
#sd.RotateFlipType(
"""
master_list = []
img = sd.Image.FromFile(imgDir)

# for now no multicore
def process_images(master):
    image = master[1]
    coords = master[2]
    image_id = master[3]
    area_id = master[4]
col = []

"""

colTr = tree[object]()
for im in range(len(bit)):
    #for each image
    #img_tmp = sd.Image.FromFile(imgDirL[im])
    """
    img_tmp = bt(imgDirL[im])
    imgL = img_tmp.Clone()
    img_tmp.Dispose()
    """
    pth = ghpath(im)
    imgL = bit[im]
    for j in range(len(pixID)):
        cc = imgL.GetPixel(pixID[j][0], pixID[j][1])
        #col.append(cc)
        colTr.Add(cc, pth)
# ---------- end ghpython_script_2 ----------
coltr = ClusterOutput(ghpython_script_2)

# ==== cluster Cluster
curves = ClusterInput()
tolerance = ClusterInput()
curves_2 = Data(curves)
tolerance_2 = Data(tolerance)
simplify_curve = SimplifyCurve(Curve=curves_2, Tolerance=tolerance_2, AngleTolerance=tolerance_2)  # -> Curve, Simplified
explode = Explode(Curve=reparameterize(simplify_curve.Curve), Recursive=True)  # -> simplify(Segments), Vertices
evaluate_curve = EvaluateCurve(Curve=reparameterize(explode.Segments), Parameter=0.5)  # -> Point, Tangent, Angle
point_on_curve = PointOnCurve(explode.Segments, parameter=0.5)
length = Length(Curve=explode.Segments)
sort_list = SortList(Keys=length, ValuesValuesA=evaluate_curve.Tangent, ValuesA=point_on_curve)  # -> reverse(Keys), reverse(ValuesValuesA), reverse(ValuesA)
# Vector of longest Segment is chooses
list_item = ListItem(List=sort_list.ValuesValuesA, Index=0, Wrap=True)  # -> flatten(Item)
list_item_2 = ListItem(List=sort_list.ValuesA, Index=0, Wrap=True)  # -> flatten(Item)
orthogonal_vectors = CSharpScript(x=list_item, y=list_item)  # -> A; inputs x: list of Vector3d, y: list of Point3d
# ---------- orthogonal_vectors: C# ----------
    List<Vector3d> vList = new List<Vector3d>();
    
    for (int i = 0; i < x.Count; i++)
    {
    
      int xx = 1;
      int yy = 1;
      
      // ensure x is always positive & that one of x or y is flipt 
      if ( y[i].Y < 0) 
      {yy = -1;} else xx = -1;
      
      Vector3d newVC = new Vector3d(y[i].Y * yy, y[i].X * xx, 0);
      vList.Add(newVC);
    
    }
    
    A = vList;
# ---------- end orthogonal_vectors ----------
A = ClusterOutput(orthogonal_vectors)
ori_vector = ClusterOutput(list_item)
